# Dynamo graph 1.3.6 test.dyn (Dynamo 2.6.1.8786)

python_script = Python()  # unwired: IN[0]
# ---------- python_script.python (7 lines) ----------
elems = ('aklSjdhfvniaydbiushbhsnkvgdfjgidkyntuweryoifwyeiurwytngiuweryngtiuerwyntgiuryntiguyWneriutynwoieruytngiuyWropmif47u5983247569urtyb5982760b984576b-307n0ufw48923n459G2837n4g9542n9hf592138475GnA890347gn024-98umf-0934u8d'*325).split('3')

text = ''
for el in elems:
	text+=(el+'SadfaW12')
	
OUT = text
# ----------------------------------------

# group: Находим "g" в встроке ,ставь значение "true" для нахождения в м. и б. буквы
code_block = CodeBlock { "g"; }
code_block_2 = CodeBlock { 1; }
allIndicesOf = String.AllIndicesOf(str=python_script, searchFor=code_block, ignoreCase=code_block_2)

sum = Math.Sum(values=allIndicesOf)

# group: Находим последнюю буквы S
code_block_3 = CodeBlock { "S"; }
lastIndexOf = String.LastIndexOf(str=python_script, searchFor=code_block_3)

mul = sum * lastIndexOf
