# Dynamo graph 1.5.9 test.dyn (Dynamo 2.6.1.8786)

python_script = Python()  # unwired: IN[0]
# ---------- python_script.python (7 lines) ----------
elems = ('aklSjdgghfvniaydbiushbhsnkvgdfjgidkyntuweryoifwyeiurwytngiuweryngtiuerwyntgiuryntiguyWneriutynwoieruytngiuyWrwwopmif47u5983247569urtyb5982760b984576b-307n0ufw48923n459G2837n4g9542n9hf592138475GnA890347gn02xx4-98umf-0934u8d'*325).split('3')

text = ''
for el in elems:
	text+=(el+'SadfaW12')
	
OUT = text
# ----------------------------------------

# group: Создаем список из строки с разделителем "ww"
code_block = CodeBlock { "ww"; }
split = String.Split(str=python_script, separator0=code_block)

# group: Делим список на длинну в 7 элементов
code_block_2 = CodeBlock { 7; }
chop = List.Chop(list=split, lengths=code_block_2)

# group: Берем каждый третий индекс
code_block_3 = CodeBlock { 3; }
getItemAtIndex = List.GetItemAtIndex(list=chop@L2, index=code_block_3)

uniqueItems = List.UniqueItems(list=getItemAtIndex)
string_from_array = FromArray(arr=uniqueItems)
length = String.Length(str=string_from_array)
