# Dynamo graph 3.1.6 test.dyn (Dynamo 2.6.1.8786)

# group: С помощью нода выбираем все элементы оз. ,для этого выделяем их и изолируем для упрощения работы
select_model_elements = DSModelElementsSelection()  # 77 picked in the model

# group: Создаем переменную с их ID и суммируем
code_block = CodeBlock(a=select_model_elements) { a.Id; }
sum = Math.Sum(values=code_block)

watch = Watch(sum)
