# Dynamo graph 3.2.5 test.dyn (Dynamo 2.6.1.8786)

code_block = CodeBlock { "\n"; }
element_types = ElementTypes("FloorType")
all_elements_of_type = ElementsOfType(element_type=element_types)
categories = Categories("OST_Floors")
all_elements_of_category = ElementsOfCategory(Category=categories)
elementType = Element.ElementType(element=all_elements_of_category)
setDifference = List.SetDifference(list1=all_elements_of_type, list2=elementType)
code_block_2 = CodeBlock { "Толщина"; }
getParameterValueByName = Element.GetParameterValueByName(element=setDifference, parameterName=code_block_2)
sortByKey = List.SortByKey(list=setDifference, keys=getParameterValueByName)
name = Element.Name(element=sortByKey.sorted_list)
join = String.Join(separator=code_block, string0=name)
watch = Watch(join)
length = String.Length(str=join)
watch_2 = Watch(length)
