# Dynamo graph Home.dyn (Dynamo 2.6.1.8786)

string = StringInput("Dynamo")
string_from_object = FromObject(obj=string)
number = DoubleInput(574)
string_2 = StringInput("баба яга")
string_3 = StringInput("баба")
string_4 = StringInput("Галя")
concat = String.Concat(string0=string_2, string1=string_3, string2=string_4)
watch = Watch(concat)
code_block = CodeBlock { "dynamo"; "test"; }
length = String.Length(str=code_block.out0)
code_block_2 = CodeBlock { "j"; }
boolean = BoolSelector(true)
contains = String.Contains(str=string, searchFor=code_block_2, ignoreCase=boolean)
replace = String.Replace(str=string_2, searchFor=string_3, replaceWith=string_4)
code_block_3 = CodeBlock(a=string_3, b=string_4) { a+" "+b; }
string_5 = StringInput("")
number_2 = DoubleInput(574)
number_slider = DoubleSlider(571, range=0..1000 step 1)
code_block_4 = CodeBlock { 25; }
integer_slider = IntegerSlider(0, range=0..100 step 1)
code_block_5 = CodeBlock { "57456"; }
toNumber = String.ToNumber(str=code_block_5)
code_block_6 = CodeBlock { 0; }
code_block_7 = CodeBlock { 10; }
code_block_8 = CodeBlock { 1; }
sequence = Sequence(start=code_block_6, amount=code_block_7, step=code_block_8)
code_block_9 = CodeBlock { 0..100..10; }
code_block_10 = CodeBlock { -55; }
abs = Math.Abs(number=code_block_10)
code_block_11 = CodeBlock(a=code_block_10) { Math.Abs (a); }
code_block_12 = CodeBlock { 45; }
cos = Math.Cos(angle=code_block_12)
code_block_13 = CodeBlock(x=code_block_12) { Math.Cos(x); }
code_block_14 = CodeBlock { 21312; }
number_slider_2 = DoubleSlider(74, range=0..100 step 1)
random = Math.Random(value1=code_block_14, value2=number_slider_2)
code_block_15 = CodeBlock { 0; }
round = Math.Round(number=random, digits=code_block_15)
list_create = List.Create(item0=code_block_6, item1=code_block_7, item2=code_block_8)
code_block_16 = CodeBlock { [1..5]; }
code_block_17 = CodeBlock { [2..7]; }
join = List.Join(list0=code_block_16, list1=code_block_17)
transpose = List.Transpose(lists=join)
flatten = List.Flatten(list=transpose)
count = List.Count(list=flatten)
code_block_18 = CodeBlock { [1,50,6,10]; }
sort = List.Sort(list=code_block_18)
code_block_19 = CodeBlock { [1,2,3]; }
code_block_20 = CodeBlock { 3; }
eq = code_block_19 == code_block_20
filterByBoolMask = List.FilterByBoolMask(list=code_block_19, mask=eq)
code_block_21 = CodeBlock { "man"; }
code_block_22 = CodeBlock { "sword"; }
code_block_23 = CodeBlock { "big"; }
list_create_2 = List.Create(item0=code_block_21, item1=code_block_22, item2=code_block_23)
code_block_24 = CodeBlock { "tolken big man "; }
contains_2 = String.Contains(str=code_block_24, searchFor=list_create_2)
filterByBoolMask_2 = List.FilterByBoolMask(list=list_create_2, mask=contains_2)
