# Dynamo graph Home21.dyn (Dynamo 2.6.1.8786)

code_block = CodeBlock { 0; }
code_block_2 = CodeBlock { 5; }
code_block_3 = CodeBlock { 10; }
byCoordinates = Point.ByCoordinates(x=code_block, y=code_block_2, z=code_block_3)
code_block_4 = CodeBlock { Point.ByCoordinates(5,5,15); }
byStartPointEndPoint = Line.ByStartPointEndPoint(startPoint=byCoordinates, endPoint=code_block_4)
code_block_5 = CodeBlock { Line.ByStartPointEndPoint(Point.ByCoordinates(0,0,0),Point.ByCoordinates(0,15,3)); }
join = List.Join(list0=byStartPointEndPoint, list1=code_block_5)
byLoft = Surface.ByLoft(crossSections=join)
code_block_6 = CodeBlock { 2; }
thicken = Surface.Thicken(surface=byLoft, thickness=code_block_6)
