# Dynamo graph test3.2.dyn (Dynamo 2.6.1.8786)

getParameterValueByName = Element.GetParameterValueByName()  # unwired: element, parameterName
code_block = CodeBlock { "Толщина"; }
getParameterValueByName_2 = Element.GetParameterValueByName(element=getParameterValueByName, parameterName=code_block)
sort = List.Sort(list=getParameterValueByName_2)
select_model_elements = DSModelElementsSelection()  # 16 picked in the model
code_block_2 = CodeBlock(a=select_model_elements) { a.Id; }
all_elements_of_category = ElementsOfCategory(Category=code_block_2)
element_by_id = ElementById(Id=code_block_2)
code_block_3 = CodeBlock { "Тип"; }
getParameterValueByName_3 = Element.GetParameterValueByName(element=element_by_id, parameterName=code_block_3)
name = Category.Name()  # unwired: category
getCategory = Element.GetCategory()  # unwired: element
uniqueItems = List.UniqueItems(list=getCategory)
all_elements_of_category_2 = ElementsOfCategory(Category=uniqueItems)
flatten = List.Flatten(list=all_elements_of_category_2)
element_types = ElementTypes("FloorType")
all_elements_of_type = ElementsOfType(element_type=element_types)
setDifference = List.SetDifference(list1=all_elements_of_type, list2=getParameterValueByName)
code_block_4 = CodeBlock { "Толщина"; }
getParameterValueByName_4 = Element.GetParameterValueByName(element=setDifference, parameterName=code_block_4)
sortByKey = List.SortByKey(list=setDifference)  # unwired: keys
name_2 = Element.Name(element=all_elements_of_type)
categories = Categories("OST_Floors")
all_elements_of_category_3 = ElementsOfCategory(Category=categories)
name_3 = Element.Name(element=all_elements_of_category_3)
eq = name_2 == name_3  # lacing=Longest
code_block_5 = CodeBlock { "\n"; }
categories_2 = Categories("OST_Floors")
all_elements_of_category_4 = ElementsOfCategory(Category=categories_2)
element_types_2 = ElementTypes("FloorType")
all_elements_of_type_2 = ElementsOfType(element_type=element_types_2)
name_4 = Element.Name(element=all_elements_of_type_2)
name_5 = Element.Name(element=all_elements_of_category_4)
eq_2 = name_4 == name_5  # lacing=Longest
filterByBoolMask = List.FilterByBoolMask(list=all_elements_of_category_4, mask=eq_2)
code_block_6 = CodeBlock { "Толщина"; }
getParameterValueByName_5 = Element.GetParameterValueByName(element=filterByBoolMask.out, parameterName=code_block_6)
sortByKey_2 = List.SortByKey(list=filterByBoolMask.out, keys=getParameterValueByName_5)
name_6 = Family.Name(family=sortByKey_2.sorted_list)
join = String.Join(separator=code_block_5, string0=name_6)
watch = Watch(join)
length = String.Length(str=join)
setDifference_2 = List.SetDifference()  # unwired: list1, list2
